# Grasshopper definition TEST111.gh (Grasshopper 0.9.14)
# plug-ins: LunchBox

pt = Point(<point referenced from the Rhino model>)
pt_2 = Point(<point referenced from the Rhino model>)
pt_3 = Point(<point referenced from the Rhino model>)
srf = Surface(<surface referenced from the Rhino model>)
crv = Curve(Vertices=[pt_2, pt, pt_3], Degree=3, Periodic=False)  # -> Curve, Length, Domain
diamond = DiamondPanels(Surface=srf, UDivisions=10, VDivisions=10)  # -> DiamondPanels, TriPanels
explode = BrepComponents(Brep=diamond.DiamondPanels)  # -> Faces, Edges, Vertices
quads = QuadPanels(Surface=srf, UDivisions=10, VDivisions=10)
diamond_2 = DiamondPanels(Surface=srf, UDivisions=10, VDivisions=10)  # -> DiamondPanels, TriPanels
item = ListItem(List=explode.Vertices, Index="0", Wrap=False)
item_2 = ListItem(List=explode.Vertices, Index="2", Wrap=False)
offset = Offset(Curve=diamond.DiamondPanels, Distance=-0.3, Plane=PlaneXY(0, 0, 0), Corners=1)  # -> flatten(Curve)
disc = Discontinuity(Curve=quads, Level=1)  # -> Points, Parameters
area = Area(Geometry=diamond.DiamondPanels)  # -> Area, Centroid
ln = Line(StartPoint=item, EndPoint=item_2)
sdiff = SolidDifference(BrepsA=diamond.DiamondPanels, BrepsB=offset)
item_3 = ListItem(List=disc.Points, Index=0, Wrap=False)
item_4 = ListItem(List=disc.Points, Index=2, Wrap=False)
area_2 = Area(Geometry=offset)  # -> Area, Centroid
ln_2 = Line(StartPoint=item_3, EndPoint=item_4)
panel = Panel(explode.Edges)
