# Grasshopper definition attractor 1- grid circle with line.gh (Grasshopper 0.8.66)

slider = Slider(3, range=0..500)
series = Series(Start=0, Step=slider, Count=Slider(65, range=0..500))
series_2 = Series(Start=0, Step=slider, Count=Slider(50, range=0..500))
crv = Curve(<curve referenced from the Rhino model>)
crv_2 = Curve(<curve referenced from the Rhino model>)
crv_3 = Curve(<curve referenced from the Rhino model>)
pt = PointXYZ(XComponent=series, YComponent=series_2, ZComponent=0, System=PlaneXY(0, 0, 0), DataComparison="cross_reference")
crv_cp = CurveCP(Point=pt, Curve=crv)  # -> Point, Parameter, Distance
crv_cp_2 = CurveCP(Point=pt, Curve=crv_2)  # -> Point, Parameter, Distance
crv_cp_3 = CurveCP(Point=pt, Curve=crv_3)  # -> Point, Parameter, Distance
min = Minimum(A=crv_cp.Distance, B=crv_cp_2.Distance)
min_2 = Minimum(A=crv_cp_2.Distance, B=crv_cp_3.Distance)
min_3 = Minimum(A=min, B=min_2)
division = Division(A=min_3, B=Slider(20, range=1..20))
division_2 = Division(A=slider, B=2)
min_4 = Minimum(A=division, B=division_2)
cir = Circle(Plane=pt, Radius=min_4)
