# Grasshopper definition flatten n number contour.gh (Grasshopper 0.9.6)

crv = Curve([<curve referenced from the Rhino model> x56])
series = Series(Start=0, Step="2000", Count="145")
pt = Point(<point referenced from the Rhino model>)
lng = ListLength(List=crv)
Y = UnitY(Factor=series)
multiplication = Multiplication(A=lng, B="1000")
addition = Addition(A="8000", B=multiplication)
dom = Domain()
move = Move(Geometry=pt, Motion=expr("-t", Y))  # -> Geometry, Transform
dom_2 = Domain(DomainStart="8000", DomainEnd=addition)
range = Range(Domain=dom_2, Steps=lng)
mindex = MemberIndex(Set=move.Geometry, Member=move.Geometry)  # -> flatten(Index), Count
Y_2 = UnitY(Factor=range)
crv_2 = Curve([<curve referenced from the Rhino model> x50])
points = PointList(Points=move.Geometry, Tags=True, Lines=True, Size="30")
move_2 = Move(Geometry=crv, Motion=Y_2)  # -> Geometry, Transform
eval = EvaluateLength(Curve=move_2.Geometry, Length=0.75, Normalized=True)  # -> Point, Tangent, Parameter
lng_2 = ListLength(List=move_2.Geometry)
division = Division(A=lng_2, B=2)
tag = TextTag3D(Location=move.Geometry, Text=mindex.Index, Size="30")
mindex_2 = MemberIndex(Set=eval.Point, Member=eval.Point)  # -> flatten(Index), Count
crv_3 = Curve([<curve referenced from the Rhino model> x53])
split = SplitList(List=move_2.Geometry, Index=division)  # -> ListA, ListB
offset = Offset(Curve=move_2.Geometry, Distance=expr("-D", "20"), Plane=PlaneXY(0, 0, 0), Corners=1)
Y_3 = UnitY(Factor="1000")
Y_4 = UnitY(Factor="1000")
Y_5 = UnitY(Factor="-30")
Y_6 = UnitY(Factor="1000")
move_3 = Move(Geometry=move_2.Geometry, Motion=Y_3)  # -> Geometry, Transform
move_4 = Move(Geometry=eval.Point, Motion=Y_5)  # -> Geometry, Transform
move_5 = Move(Geometry=split.ListA, Motion=expr("-t", Y_6))  # -> Geometry, Transform
move_6 = Move(Geometry=split.ListB, Motion=Y_4)  # -> Geometry, Transform
tag_2 = TextTag3D(Location=move_4.Geometry, Text=mindex_2.Index, Size="30")
offset_2 = Offset(Curve=move_3.Geometry, Distance="15", Plane=PlaneXY(0, 0, 0), Corners=1)
