# Grasshopper definition ribbon.gh (Grasshopper 0.9.14)

brep = Brep(<brep referenced from the Rhino model>)

# ---- group: divide surface
sdivide = DivideSurface(Surface=brep, UCount=Slider(29, range=0..50), VCount=Slider(9, range=0..50))  # -> Points, Normals, Parameters

# ---- group: rotation source
geo = Geometry(<curve referenced from the Rhino model>)

# ---- group: ribbon direction filter
slider = Slider(0, range=0..50)
flip = FlipMatrix(Data=sdivide.Points)
filter = StreamFilter(Gate=slider, Stream0=sdivide.Points, Stream1=flip)

# ---- group: frames for rotation
intcrv = Interpolate(Vertices=filter, Degree=3, Periodic=False, KnotStyle=1)  # -> Curve, Length, Domain
pframes = PerpFrames(Curve=intcrv.Curve, Count=Slider(27, range=0..50), Align=True)  # -> Frames, Parameters

# ---- group: lines for rotation
flip_2 = FlipMatrix(Data=pframes.Frames)
shift = ShiftList(List=flip_2, Shift="1", Wrap=False)
shift_2 = ShiftList(List=flip_2, Shift="-1", Wrap=False)
ln = Line(StartPoint=shift, EndPoint=shift_2)

# ---- group: min distance
pull = PullPoint(Point=shift, Geometry=geo, Closest=True)  # -> ClosestPoint, Distance

# ---- group: ribbon direction filter (continued)
rev = Reverse(Vector=shift)
filter_2 = StreamFilter(Gate=slider, Stream0=rev, Stream1=shift)

# ---- group: strength & coverage
multiplication = Multiplication(A=pull.Distance, B=Slider(4, range=0..50))
min = Minimum(A=multiplication, B=Slider(100, range=0..100))

# ---- group: rotation range
dom = Domain(DomainStart=Slider(90, range=0..90), DomainEnd=Slider(0, range=0..90))
bnd = Bounds(Numbers=flatten(min))
remap = RemapNumbers(Value=min, Source=bnd, Target=dom)

# ---- group: rotation
rot3d = Rotate3D(Geometry=ln, Angle=degrees(remap), Center=shift, Axis=filter_2)  # -> Geometry, Transform
flip_3 = FlipMatrix(Data=rot3d.Geometry)

# ---- group: ribbons
loft = Loft(Curves=flip_3, Options={Adjust=False, Closed=False, Rebuild=10, Refit=0.01, LoftType=0, LoftEnds=0, LoftSimp=0})

# ----
lng = ListLength(List=flatten(loft))
gradient = Gradient(
    LowerLimit=0,
    UpperLimit=lng,
    Parameter=flatten(loft),
    stops=[0: RGB(236, 27, 60), 0.163: RGB(247, 159, 20), 0.3: RGB(103, 0, 120), 0.4: RGB(39, 72, 161), 0.458: RGB(243, 57, 0), 0.5: RGB(1, 192, 229), 0.557: RGB(210, 0, 118), 0.6: RGB(18, 178, 90), 0.601: RGB(243, 57, 0), 0.7: RGB(79, 186, 8), 0.8: RGB(220, 237, 32)])
preview = CustomPreview(Geometry=loft, Shader=gradient)
