# Grasshopper definition site model box.gh (Grasshopper 0.8.66)

panel = Panel("3")  # disabled
slider = Slider(5, range=1..20)  # disabled
panel_2 = Panel("1.1")  # disabled
panel_3 = Panel("-0.15")  # disabled
crv = Curve([<curve referenced from the Rhino model> x31])  # disabled
panel_4 = Panel("3")  # disabled
crv_2 = Curve(<curve referenced from the Rhino model>)
slider_2 = Slider(4, range=1..20)  # disabled
panel_5 = Panel("1.1")  # disabled
crv_3 = Curve([<curve referenced from the Rhino model> x32])  # disabled
multiplication = Multiplication(A=slider, B=panel)  # disabled
crv_4 = Curve([<curve referenced from the Rhino model> x41])  # disabled
addition = Addition(A=multiplication, B=panel_2)  # disabled
crv_5 = Curve([<curve referenced from the Rhino model> x2])
Z = UnitZ(Factor=panel_3)  # disabled
multiplication_2 = Multiplication(A=slider_2, B=panel_4)  # disabled
Z_2 = UnitZ(Factor=addition)  # disabled
multiplication_3 = Multiplication(A=Slider(5, range=1..20), B="3")
addition_2 = Addition(A=multiplication_2, B=panel_5)  # disabled
Z_3 = UnitZ(Factor="0.15")
extr = Extrude(Base=crv, Direction=Z_2)  # disabled
extr_2 = Extrude(Base=crv_3, Direction=Z)  # disabled
addition_3 = Addition(A=multiplication_3, B="1.1")
Z_4 = UnitZ(Factor=addition_2)  # disabled
extr_3 = Extrude(Base=crv_2, Direction=Z_3)
_5f = CapHoles(Brep=extr)  # disabled
Z_5 = UnitZ(Factor=addition_3)
cap = CapHoles(Brep=extr_2)  # disabled
extr_4 = Extrude(Base=crv_4, Direction=Z_4)  # disabled
t = CapHoles(Brep=extr_3)
extr_5 = Extrude(Base=crv_5, Direction=Z_5)
_5f_2 = CapHoles(Brep=extr_5)
Z_6 = UnitZ(Factor=Slider(3, range=1..20))
_5f_3 = CapHoles(Brep=extr_4)  # disabled
move = Move(Geometry=t, Motion=Z_6)  # -> Geometry, Transform
