# Grasshopper definition slope way.gh (Grasshopper 0.8.66)

crv = Curve(<curve referenced from the Rhino model>)
offset_crv = Slider(60, range=60..120)
divide_crv = Slider(14, range=5..30)
slope = Slider(12, range=5..30)
extrude_thickness = Slider(15, range=0..15)
len = Length(Curve=crv)
Z = UnitZ(Factor=expr("-f", extrude_thickness))
division = Division(A=len, B=slope)
offset = Offset(Curve=crv, Distance=expr("-d", offset_crv), Plane=PlaneXY(0, 0, 0), Corners=1)
eval = EvaluateLength(Curve=crv, Length=Slider(423, range=60..800), Normalized=False)  # -> Point, Tangent, Parameter
range = Range(Domain=division, Steps=divide_crv)
offset_2 = Offset(Curve=crv, Distance=offset_crv, Plane=PlaneXY(0, 0, 0), Corners=1)
divide = DivideCurve(Curve=offset_2, Count=divide_crv, Kinks=False)  # -> Points, Tangents, Parameters
divide_2 = DivideCurve(Curve=offset, Count=divide_crv, Kinks=False)  # -> Points, Tangents, Parameters
Z_2 = UnitZ(Factor=range)
move = Move(Geometry=divide.Points, Motion=Z_2)  # -> Geometry, Transform
move_2 = Move(Geometry=divide_2.Points, Motion=Z_2)  # -> Geometry, Transform
intcrv = Interpolate(Vertices=move.Geometry, Degree=3, Periodic=False)  # -> Curve, Length, Domain
intcrv_2 = Interpolate(Vertices=move_2.Geometry, Degree=3, Periodic=False)  # -> Curve, Length, Domain
end = EndPoints(Curve=intcrv.Curve)  # -> Start, End
end_2 = EndPoints(Curve=intcrv_2.Curve)  # -> Start, End
ln = Line(StartPoint=end.Start, EndPoint=end_2.Start)
swp2 = Sweep2(Rail1=intcrv.Curve, Rail2=intcrv_2.Curve, Sections=ln, SameHeight=False)
extr = Extrude(Base=swp2, Direction=Z)
