# Grasshopper definition subdivide_triangle.ghx (Grasshopper 0.9.76)

brep = Brep(<brep referenced from the Rhino model>)
volume = Volume(Geometry=brep)  # -> Volume, Centroid
scale = Scale(Geometry=brep, Center=volume.Centroid, Factor="0.98")  # -> Geometry, Transform
debrep = DeconstructBrep(Brep=scale.Geometry)  # -> Faces, Edges, Vertices
srf = Srf(graft(debrep.Faces))
explode = Explode(Curve=srf, Recursive=True)  # -> simplify(Segments), Vertices
slider = Slider(5, range=1..20)
item = IT(List=explode.Segments, Index=0, Wrap=False)
item_2 = IT(List=explode.Segments, Index=2, Wrap=False)
item_3 = IT(List=explode.Segments, Index=1, Wrap=False)
midpt = Midpt(crv=item)
crv2vec = Crv2Vec(crv=item_2)
crv2vec_2 = Crv2Vec(crv=item_3)
srf_cp = SurfaceCP(Point=midpt, Surface=srf)  # -> Point, UVPoint, Distance
item_4 = IT(List=explode.Vertices, Index=2, Wrap=False)
one_over_x = OneOverX(Value=slider)
eval = EvaluateSurface(Surface=srf, Point=srf_cp.UVPoint)  # -> Point, Normal, Frame
multiplication = Multiplication(A=crv2vec, B=one_over_x)
multiplication_2 = Multiplication(A=crv2vec_2, B=one_over_x)
series = Series(Start=0, Step=1, Count=slider)
rotate = Rotate(Geometry=srf, Angle="pi", Plane=eval.Frame)  # -> Geometry, Transform
merge = Merge(Data1=srf, Data2=rotate.Geometry)
scale_2 = Scale(Geometry=merge, Center=item_4, Factor=one_over_x)  # -> Geometry, Transform
multiplication_3 = Multiplication(A=multiplication_2, B=series)
multiplication_4 = Multiplication(A=multiplication, B=series)
crossref = CrossReference(ListA=scale_2.Geometry, ListB=multiplication_4, CrossMode=1)  # -> ListA, ListB
move = Move(Geometry=crossref.ListA, Motion=crossref.ListB)  # -> Geometry, Transform
crossref_2 = CrossReference(ListA=move.Geometry, ListB=multiplication_3, CrossMode=1)  # -> ListA, ListB
move_2 = Move(Geometry=crossref_2.ListA, Motion=expr("-x", crossref_2.ListB))  # -> Geometry, Transform
pcen = PolygonCenter(Polyline=move_2.Geometry)  # -> CenterV, CenterE
srf_cp_2 = SurfaceCP(Point=pcen.CenterV, Surface=srf)  # -> Point, UVPoint, Distance
smaller = SmallerThan(FirstNumber=srf_cp_2.Distance, SecondNumber="0.01")  # -> SmallerThan, OrEqualTo
dispatch = Dispatch(List=move_2.Geometry, DispatchPattern=smaller.SmallerThan)  # -> ListA, ListB
srf_2 = Srf(dispatch.ListA)
edges = BrepEdges(Brep=srf_2)  # -> flatten(Naked), Interior, NonManifold
crv = Curve(edges.Naked)
pipe = Pipe(Curve=crv, Radius="25", Caps=0)

# ==== cluster Midpt
crv = ClusterInput()
crv_2 = Curve(crv)
eval = EvaluateCurve(Curve=reparameterize(crv_2), Parameter="0.5")  # -> Point, Tangent, Angle
P = ClusterOutput(eval.Point)

# ==== cluster Crv2Vec
crv = ClusterInput()
crv_2 = Curve(crv)
end = EndPoints(Curve=crv_2)  # -> Start, End
vec2pt = Vector2Pt(PointA=end.Start, PointB=end.End, Unitize=False)  # -> Vector, Length
vec = Vector(vec2pt.Vector)
vec_2 = ClusterOutput(vec)
